# Dynamo custom node BounceDraw.dyf
# category: MyGame

spriteBatch = Input()
test_sprite = TestSprite()
width = Input()
number = DoubleInput(2)
divide = Division(width, number, lacing=Longest)
world = Input()
first_in_list = First(world)
vector2 = NewVector2(divide, first_in_list)
draw_sprite = DrawSprite(spriteBatch, test_sprite, vector2)
Output = Output(draw_sprite)  # ""
