# Dynamo custom node BounceUpdate.dyf
# category: MyGame

world = Input()
split_pair = DeCons(world)
radius = Input()
height = Input()
update_shouldbounce = Custom[Update-ShouldBounce](ball_pos=split_pair.out0, ball_radius=radius, world_height=height)
first_in_list = First(split_pair.out1)
update_performbounce = Custom[Update-PerformBounce](ball_vel=first_in_list, ball_radius=radius, world_height=height)
gravity = Input()
gameTime = Input()
milliseconds = GameTimeElapsedMilliseconds(gameTime)  # "GameTime.Milliseconds"
update_applygravity = Custom[Update-ApplyGravity](ball_pos=split_pair.out0, ball_vel=first_in_list, gravity=gravity, tick=milliseconds)
if_ = Conditional(update_shouldbounce, update_performbounce, update_applygravity)
newWorld = Output(if_)
watch = Input()
apply = Apply1(arg1=watch, if_)
