# Dynamo custom node Update-ApplyGravity.dyf
# category: MyGame

ball_pos = Input()
ball_vel = Input()
tick = Input()
multiply = Multiplication(ball_vel, tick, lacing=Longest)
add = Addition(ball_pos, multiply, lacing=Longest)
gravity = Input()
multiply_2 = Multiplication(gravity, tick, lacing=Longest)
add_2 = Addition(ball_vel, multiply_2, lacing=Longest)
list = NewList(index0=add, index1=add_2)
movedWorld = Output(list)
