# Dynamo custom node Update-PerformBounce.dyf
# category: MyGame

world_height = Input()
ball_radius = Input()
subtract = Subtraction(world_height, ball_radius, lacing=Longest)
number = DoubleInput(-0.9)
add = Addition(subtract, number, lacing=Longest)
ball_vel = Input()
multiply = Multiplication(ball_vel, number, lacing=Longest)
list = NewList(index0=add, index1=multiply)
bouncedWorld = Output(list)
