# Dynamo custom node Update-ShouldBounce.dyf
# category: MyGame

ball_pos = Input()
ball_radius = Input()
add = Addition(ball_pos, ball_radius, lacing=Longest)
world_height = Input()
greater_than_or_equal = GreaterThanEquals(add, world_height)
Output = Output(greater_than_or_equal)  # ""
