# Dynamo graph xna-test.dyn

number = DoubleInput(15)
number_slider = DoubleSliderInput(0.005755395683, range=0..0.1)
number_2 = DoubleInput(800)
ID = Custom[ID]()
bounceUpdate = Custom[BounceUpdate](radius=number, gravity=number_slider, height=number_2, watch=ID)
number_3 = DoubleInput(200)
bounceDraw = Custom[BounceDraw](width=number_3)
number_4 = DoubleInput(30)
number_5 = DoubleInput(0)
list = NewList(index0=number_4, index1=number_5)
new_game = NewGame(bounceUpdate, bounceDraw, list, number_3, number_2)
